% Simulink data dictionary DD_CurrPowerLimCalc.sldd
% references Shared_DD.sldd

MinCellVoltDchrgCurrentLim = Simulink.Signal(StorageClass="ExportedGlobal", DataType="single")
LowTempDchrgCurrentLim = Simulink.Signal(StorageClass="ExportedGlobal", DataType="single")
HighTempDchrgCurrentLim = Simulink.Signal(StorageClass="ExportedGlobal", DataType="single")
MinCellVolt = Simulink.Signal(StorageClass="ExportedGlobal", DataType="single", Min=0, Max=5, Unit="V")
MaxCellVolt = Simulink.Signal(StorageClass="ExportedGlobal", DataType="single", Min=0, Max=5, Unit="V")
MaxCellTemp = Simulink.Signal(StorageClass="ExportedGlobal", DataType="single", Min=-25, Max=80, Unit="C")
MinCellTemp = Simulink.Signal(StorageClass="ExportedGlobal", DataType="single", Min=-25, Max=80, Unit="C")
MinMaxCells = Simulink.Signal(StorageClass="ExportedGlobal", DataType="Bus: Min_Max_Cells")
MaxCellVoltChrgCurrentLim = Simulink.Signal(StorageClass="ExportedGlobal", DataType="single")
LowTempChrgCurrentLim = Simulink.Signal(StorageClass="ExportedGlobal", DataType="single")
HighTempChrgCurrentLim = Simulink.Signal(StorageClass="ExportedGlobal", DataType="single")

MinCellVoltDchrgCurrentLimTable = Simulink.LookupTable(
  Table=Simulink.lookuptable.Table(
    Description="Discharge Current Rate Based On Mim Cell Voltage",
    Value=single([0 0.5 1]),
    Dimensions=[1 3],
    DataType="single",
    FieldName="DischargeCurrentRate"),
  BreakpointsSpecification="Explicit values",
  Breakpoints=Simulink.lookuptable.Breakpoint(
    Description="Minimum Cell Voltage",
    Value=[2.5; 2.75; 3],
    TunableSizeName="N1",
    Dimensions=[3 1],
    DataType="single",
    Unit="V",
    FieldName="MinCellVoltage"))

MaxChrgCurrLim = Simulink.Parameter(3.3, DataType="single", Unit="A")
MaxDchrgCurrLim = Simulink.Parameter(-10, DataType="single", Unit="A")
OverCellVoltageLimit = Simulink.Parameter(4.25, StorageClass="ExportedGlobal", DataType="single", Unit="V")  % Maximum Cell Voltage Limit to Trigger Fault
UnderCellVoltageLimit = Simulink.Parameter(2.5, StorageClass="ExportedGlobal", DataType="single", Unit="V")  % Minimum Cell Voltage Limit to Trigger Fault
LowCellTempLimit = Simulink.Parameter(-15, StorageClass="ExportedGlobal", DataType="single", Unit=" degC")  % Low Cell Temperature Limit to Trigger Fault
HighCellTempLimit = Simulink.Parameter(55, StorageClass="ExportedGlobal", DataType="single", Unit=" degC")  % High Cell Temperature Limit to Trigger Fault