% Simulink data dictionary FaultManagement_DD.sldd

Fault_Bus = Simulink.Bus(DataScope="Exported")
  ID: uint16
  Enable: boolean
  Sticky: boolean
  TimeToFail: single
  TimeToPass: single
  SampleTime: single
  Suspected: boolean
  Active: boolean
  Occured: boolean

FaultData = [struct(
  FaultName="PackOverCurrFlt",
  ID=uint16(0),
  Enable=true,
  Sticky=false,
  TimeToFail=single(2),
  TimeToPass=single(4),
  SampleTime=single(0.1),
  Suspected=false,
  Active=false,
  Occured=false), struct(
  FaultName="CellHighTempFlt",
  ID=uint16(1),
  Enable=true,
  Sticky=false,
  TimeToFail=single(4),
  TimeToPass=single(6),
  SampleTime=single(0.1),
  Suspected=false,
  Active=false,
  Occured=false), struct(
  FaultName="CellLowTempFlt",
  ID=uint16(2),
  Enable=true,
  Sticky=false,
  TimeToFail=single(4),
  TimeToPass=single(6),
  SampleTime=single(0.1),
  Suspected=false,
  Active=false,
  Occured=false), struct(
  FaultName="VoltSensorFlt",
  ID=uint16(3),
  Enable=true,
  Sticky=true,
  TimeToFail=single(2),
  TimeToPass=single(4),
  SampleTime=single(0.1),
  Suspected=false,
  Active=false,
  Occured=false), struct(
  FaultName="CellOverVoltFlt",
  ID=uint16(4),
  Enable=true,
  Sticky=false,
  TimeToFail=single(2),
  TimeToPass=single(4),
  SampleTime=single(0.1),
  Suspected=false,
  Active=false,
  Occured=false), struct(
  FaultName="CellUnderVoltFlt",
  ID=uint16(5),
  Enable=true,
  Sticky=false,
  TimeToFail=single(2),
  TimeToPass=single(4),
  SampleTime=single(0.1),
  Suspected=false,
  Active=false,
  Occured=false), struct(
  FaultName="ChrgCntctFlt",
  ID=uint16(6),
  Enable=true,
  Sticky=true,
  TimeToFail=single(0.5),
  TimeToPass=single(2),
  SampleTime=single(0.1),
  Suspected=false,
  Active=false,
  Occured=false), struct(
  FaultName="InvtrCntctFlt",
  ID=uint16(7),
  Enable=true,
  Sticky=true,
  TimeToFail=single(0.5),
  TimeToPass=single(2),
  SampleTime=single(0.1),
  Suspected=false,
  Active=false,
  Occured=false)]

PackOverCurrFlt = Simulink.Signal(StorageClass="ExportedGlobal", DataType="Bus: Fault_Bus", InitialValue="FaultInit.PackOverCurrFlt")
CellHighTempFlt = Simulink.Signal(StorageClass="ExportedGlobal", DataType="Bus: Fault_Bus", InitialValue="FaultInit.CellHighTempFlt")
CellLowTempFlt = Simulink.Signal(StorageClass="ExportedGlobal", DataType="Bus: Fault_Bus", InitialValue="FaultInit.CellLowTempFlt")
VoltSensorFlt = Simulink.Signal(StorageClass="ExportedGlobal", DataType="Bus: Fault_Bus", InitialValue="FaultInit.VoltSensorFlt")
CellOverVoltFlt = Simulink.Signal(StorageClass="ExportedGlobal", DataType="Bus: Fault_Bus", InitialValue="FaultInit.CellOverVoltFlt")
CellUnderVoltFlt = Simulink.Signal(StorageClass="ExportedGlobal", DataType="Bus: Fault_Bus", InitialValue="FaultInit.CellUnderVoltFlt")
ChrgCntctFlt = Simulink.Signal(StorageClass="ExportedGlobal", DataType="Bus: Fault_Bus", InitialValue="FaultInit.ChrgCntctFlt")
InvtrCntctFlt = Simulink.Signal(StorageClass="ExportedGlobal", DataType="Bus: Fault_Bus", InitialValue="FaultInit.InvtrCntctFlt")

FaultInit = struct(
  PackOverCurrFlt=struct(
    ID=uint16(0),
    Enable=true,
    Sticky=false,
    TimeToFail=single(2),
    TimeToPass=single(4),
    SampleTime=single(0.1),
    Suspected=false,
    Active=false,
    Occured=false),
  CellHighTempFlt=struct(
    ID=uint16(1),
    Enable=true,
    Sticky=false,
    TimeToFail=single(4),
    TimeToPass=single(6),
    SampleTime=single(0.1),
    Suspected=false,
    Active=false,
    Occured=false),
  CellLowTempFlt=struct(
    ID=uint16(2),
    Enable=true,
    Sticky=false,
    TimeToFail=single(4),
    TimeToPass=single(6),
    SampleTime=single(0.1),
    Suspected=false,
    Active=false,
    Occured=false),
  VoltSensorFlt=struct(
    ID=uint16(3),
    Enable=true,
    Sticky=true,
    TimeToFail=single(2),
    TimeToPass=single(4),
    SampleTime=single(0.1),
    Suspected=false,
    Active=false,
    Occured=false),
  CellOverVoltFlt=struct(
    ID=uint16(4),
    Enable=true,
    Sticky=false,
    TimeToFail=single(2),
    TimeToPass=single(4),
    SampleTime=single(0.1),
    Suspected=false,
    Active=false,
    Occured=false),
  CellUnderVoltFlt=struct(
    ID=uint16(5),
    Enable=true,
    Sticky=false,
    TimeToFail=single(2),
    TimeToPass=single(4),
    SampleTime=single(0.1),
    Suspected=false,
    Active=false,
    Occured=false),
  ChrgCntctFlt=struct(
    ID=uint16(6),
    Enable=true,
    Sticky=true,
    TimeToFail=single(0.5),
    TimeToPass=single(2),
    SampleTime=single(0.1),
    Suspected=false,
    Active=false,
    Occured=false),
  InvtrCntctFlt=struct(
    ID=uint16(7),
    Enable=true,
    Sticky=true,
    TimeToFail=single(0.5),
    TimeToPass=single(2),
    SampleTime=single(0.1),
    Suspected=false,
    Active=false,
    Occured=false))