% Simulink data dictionary Shared_DD.sldd
% references FaultManagement_DD.sldd
% references Battery_16Packs_1RC.sldd

ts = 0.1
TestCase = 1
BMS_Configuration = Simulink.ConfigSet(StartTime="0", StopTime="10000", Solver="FixedStepDiscrete", ProdHWDeviceType="Intel->x86-64 (Linux 64)", SystemTargetFile="grt.tlc", TargetLang="C++")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

Min_Max_Cells = Simulink.Bus(DataScope="Exported")
  MinCellVolt: single, Min=0, Max=5, Unit="V"
  MaxCellVolt: single, Min=0, Max=5, Unit="V"
  MinCellTemp: single, Min=-25, Max=80, Unit="C"
  MaxCellTemp: single, Min=-25, Max=80, Unit="C"

Active_Scenario_Index = 1

SRE = enum(DefaultValue="Standby")  % User State Request
  Standby = 0  % Standby or Inactive Operational State
  Charging = 1  % Charging State
  Driving = 2  % Driving State

BMS_Info = Simulink.Bus()
  Faults_Bus: Bus: Faults
  BMS_State: Enum: BMS_State_Enum
  ChargeMode: Enum: ChargeMode_Enum
  SOC: Bus: SOC_Est
  SOC_NN: single

Faults = Simulink.Bus()
  PackOverCurrFlt: boolean
  CellHighTempFlt: boolean
  CellLowTempFlt: boolean
  VoltSensorFlt: boolean
  CellOverVoltFlt: boolean
  CellUnderVoltFlt: boolean
  ChrgCntctFlt: boolean
  InvtrCntctFlt: boolean

ModuleAssembly2 = struct(
  Module1=struct(
    iCellModel=repmat(0, 6, 1),
    vCellModel=repmat(0, 6, 1),
    socCellModel=repmat(1, 6, 1),
    numCyclesCellModel=repmat(0, 6, 1),
    temperatureCellModel=repmat(298.15, 6, 1),
    vParallelAssembly=repmat(0, 6, 1),
    socParallelAssembly=repmat(1, 6, 1)),
  Module2=struct(
    iCellModel=repmat(0, 6, 1),
    vCellModel=repmat(0, 6, 1),
    socCellModel=repmat(1, 6, 1),
    numCyclesCellModel=repmat(0, 6, 1),
    temperatureCellModel=repmat(298.15, 6, 1),
    vParallelAssembly=repmat(0, 6, 1),
    socParallelAssembly=repmat(1, 6, 1)),
  Module3=struct(
    iCellModel=repmat(0, 6, 1),
    vCellModel=repmat(0, 6, 1),
    socCellModel=repmat(1, 6, 1),
    numCyclesCellModel=repmat(0, 6, 1),
    temperatureCellModel=repmat(298.15, 6, 1),
    vParallelAssembly=repmat(0, 6, 1),
    socParallelAssembly=repmat(1, 6, 1)),
  Module4=struct(
    iCellModel=repmat(0, 6, 1),
    vCellModel=repmat(0, 6, 1),
    socCellModel=repmat(1, 6, 1),
    numCyclesCellModel=repmat(0, 6, 1),
    temperatureCellModel=repmat(298.15, 6, 1),
    vParallelAssembly=repmat(0, 6, 1),
    socParallelAssembly=repmat(1, 6, 1)))

ModuleAssembly3 = struct(
  Module1=struct(
    iCellModel=repmat(0, 6, 1),
    vCellModel=repmat(0, 6, 1),
    socCellModel=repmat(1, 6, 1),
    numCyclesCellModel=repmat(0, 6, 1),
    temperatureCellModel=repmat(298.15, 6, 1),
    vParallelAssembly=repmat(0, 6, 1),
    socParallelAssembly=repmat(1, 6, 1)),
  Module2=struct(
    iCellModel=repmat(0, 6, 1),
    vCellModel=repmat(0, 6, 1),
    socCellModel=repmat(1, 6, 1),
    numCyclesCellModel=repmat(0, 6, 1),
    temperatureCellModel=repmat(298.15, 6, 1),
    vParallelAssembly=repmat(0, 6, 1),
    socParallelAssembly=repmat(1, 6, 1)),
  Module3=struct(
    iCellModel=repmat(0, 6, 1),
    vCellModel=repmat(0, 6, 1),
    socCellModel=repmat(1, 6, 1),
    numCyclesCellModel=repmat(0, 6, 1),
    temperatureCellModel=repmat(298.15, 6, 1),
    vParallelAssembly=repmat(0, 6, 1),
    socParallelAssembly=repmat(1, 6, 1)),
  Module4=struct(
    iCellModel=repmat(0, 6, 1),
    vCellModel=repmat(0, 6, 1),
    socCellModel=repmat(1, 6, 1),
    numCyclesCellModel=repmat(0, 6, 1),
    temperatureCellModel=repmat(298.15, 6, 1),
    vParallelAssembly=repmat(0, 6, 1),
    socParallelAssembly=repmat(1, 6, 1)))

ModuleAssembly4 = struct(
  Module1=struct(
    iCellModel=repmat(0, 6, 1),
    vCellModel=repmat(0, 6, 1),
    socCellModel=repmat(1, 6, 1),
    numCyclesCellModel=repmat(0, 6, 1),
    temperatureCellModel=repmat(298.15, 6, 1),
    vParallelAssembly=repmat(0, 6, 1),
    socParallelAssembly=repmat(1, 6, 1)),
  Module2=struct(
    iCellModel=repmat(0, 6, 1),
    vCellModel=repmat(0, 6, 1),
    socCellModel=repmat(1, 6, 1),
    numCyclesCellModel=repmat(0, 6, 1),
    temperatureCellModel=repmat(298.15, 6, 1),
    vParallelAssembly=repmat(0, 6, 1),
    socParallelAssembly=repmat(1, 6, 1)),
  Module3=struct(
    iCellModel=repmat(0, 6, 1),
    vCellModel=repmat(0, 6, 1),
    socCellModel=repmat(1, 6, 1),
    numCyclesCellModel=repmat(0, 6, 1),
    temperatureCellModel=repmat(298.15, 6, 1),
    vParallelAssembly=repmat(0, 6, 1),
    socParallelAssembly=repmat(1, 6, 1)),
  Module4=struct(
    iCellModel=repmat(0, 6, 1),
    vCellModel=repmat(0, 6, 1),
    socCellModel=repmat(1, 6, 1),
    numCyclesCellModel=repmat(0, 6, 1),
    temperatureCellModel=repmat(298.15, 6, 1),
    vParallelAssembly=repmat(0, 6, 1),
    socParallelAssembly=repmat(1, 6, 1)))

ParallelAssemblyType1 = struct(
  SOC_vec=[0; 0.1; 0.2; 0.3; 0.4; 0.5; 0.6; 0.7; 0.8; 0.9; 1],
  T_vec=[253.15 263.15 273.15 283.15 298.15 313.15],
  V0_mat=[1.471962 1.17056 1.972443 1.398841 2.447626 2.202431
   2.380026 2.485242 2.816572 2.794113 3.280015 3.162995
   3.251924 3.369023 3.401211 3.40776 3.477555 3.455376
   3.504286 3.510463 3.518309 3.537896 3.562188 3.552881
   3.595253 3.606702 3.598202 3.623083 3.647843 3.636326
   3.683792 3.680243 3.67719 3.685861 3.72751 3.711786
   3.776126 3.796533 3.781789 3.797116 3.835121 3.803923
   3.881924 3.888827 3.875023 3.899117 3.920594 3.90089
   3.984092 3.987494 3.986391 3.992963 4.014138 3.998957
   4.076008 4.075384 4.065285 4.069273 4.086793 4.075473
   4.119854 4.161177 4.140516 4.16349 4.181826 4.157045],
  V_range=[0 Inf],
  R0_mat=[0.3185125 0.2780749 0.1363052 0.09763589 0.07768716 0.07022368
   0.2819755 0.2163331 0.109268 0.07143903 0.0539069 0.04984501
   0.2454385 0.1545914 0.08223073 0.04524218 0.03299956 0.02992672
   0.2089014 0.09284958 0.05554696 0.03832103 0.02676865 0.02457813
   0.1733372 0.08613458 0.05299657 0.03713753 0.02565175 0.02139272
   0.177829 0.08926015 0.05328457 0.03601116 0.02881886 0.02512463
   0.1760207 0.08543414 0.05360722 0.03774101 0.02980957 0.02266258
   0.1788604 0.09210846 0.05677335 0.04021896 0.03296999 0.02720731
   0.1948125 0.1000803 0.05996225 0.04194721 0.02967007 0.02678561
   0.2430623 0.1172748 0.06366871 0.04436829 0.03067274 0.02562338
   0.4053579 0.1893636 0.09216182 0.0619174 0.03528211 0.02807986],
  AH=repmat(3, 1, 6),
  thermal_mass=45,
  CellBalancingClosedResistance=0.01,
  CellBalancingOpenConductance=1.0e-8,
  CellBalancingThreshold=0.5,
  CellBalancingResistance=50)

DriveCycleCurrent = [0 0
 0.1 0
 0.2 0
 0.3 0
 0.4 0
 0.5 0
 0.6 0
 0.7 0
 0.8 0
 0.9 0
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 ]

ModuleType1 = struct(
  SOC_vec=[0; 0.1; 0.2; 0.3; 0.4; 0.5; 0.6; 0.7; 0.8; 0.9; 1],
  T_vec=[253.15 263.15 273.15 283.15 298.15 313.15],
  V0_mat=[1.471962 1.17056 1.972443 1.398841 2.447626 2.202431
   2.380026 2.485242 2.816572 2.794113 3.280015 3.162995
   3.251924 3.369023 3.401211 3.40776 3.477555 3.455376
   3.504286 3.510463 3.518309 3.537896 3.562188 3.552881
   3.595253 3.606702 3.598202 3.623083 3.647843 3.636326
   3.683792 3.680243 3.67719 3.685861 3.72751 3.711786
   3.776126 3.796533 3.781789 3.797116 3.835121 3.803923
   3.881924 3.888827 3.875023 3.899117 3.920594 3.90089
   3.984092 3.987494 3.986391 3.992963 4.014138 3.998957
   4.076008 4.075384 4.065285 4.069273 4.086793 4.075473
   4.119854 4.161177 4.140516 4.16349 4.181826 4.157045],
  V_range=[0 Inf],
  R0_mat=[0.3185125 0.2780749 0.1363052 0.09763589 0.07768716 0.07022368
   0.2819755 0.2163331 0.109268 0.07143903 0.0539069 0.04984501
   0.2454385 0.1545914 0.08223073 0.04524218 0.03299956 0.02992672
   0.2089014 0.09284958 0.05554696 0.03832103 0.02676865 0.02457813
   0.1733372 0.08613458 0.05299657 0.03713753 0.02565175 0.02139272
   0.177829 0.08926015 0.05328457 0.03601116 0.02881886 0.02512463
   0.1760207 0.08543414 0.05360722 0.03774101 0.02980957 0.02266258
   0.1788604 0.09210846 0.05677335 0.04021896 0.03296999 0.02720731
   0.1948125 0.1000803 0.05996225 0.04194721 0.02967007 0.02678561
   0.2430623 0.1172748 0.06366871 0.04436829 0.03067274 0.02562338
   0.4053579 0.1893636 0.09216182 0.0619174 0.03528211 0.02807986],
  AH=repmat(3, 1, 6),
  thermal_mass=45,
  CellBalancingClosedResistance=0.01,
  CellBalancingOpenConductance=1.0e-8,
  CellBalancingThreshold=0.5,
  CellBalancingResistance=10)

ModuleAssembly1 = struct(
  Module1=struct(
    iCellModel=repmat(0, 6, 1),
    vCellModel=repmat(0, 6, 1),
    socCellModel=[0.98; 0.98; 0.985; 0.99; 0.99; 1],
    numCyclesCellModel=repmat(0, 6, 1),
    temperatureCellModel=repmat(298.15, 6, 1),
    vParallelAssembly=repmat(0, 6, 1),
    socParallelAssembly=repmat(1, 6, 1)),
  Module2=struct(
    iCellModel=repmat(0, 6, 1),
    vCellModel=repmat(0, 6, 1),
    socCellModel=repmat(1, 6, 1),
    numCyclesCellModel=repmat(0, 6, 1),
    temperatureCellModel=repmat(298.15, 6, 1),
    vParallelAssembly=repmat(0, 6, 1),
    socParallelAssembly=repmat(1, 6, 1)),
  Module3=struct(
    iCellModel=repmat(0, 6, 1),
    vCellModel=repmat(0, 6, 1),
    socCellModel=repmat(1, 6, 1),
    numCyclesCellModel=repmat(0, 6, 1),
    temperatureCellModel=repmat(298.15, 6, 1),
    vParallelAssembly=repmat(0, 6, 1),
    socParallelAssembly=repmat(1, 6, 1)),
  Module4=struct(
    iCellModel=repmat(0, 6, 1),
    vCellModel=repmat(0, 6, 1),
    socCellModel=repmat(1, 6, 1),
    numCyclesCellModel=repmat(0, 6, 1),
    temperatureCellModel=repmat(298.15, 6, 1),
    vParallelAssembly=repmat(0, 6, 1),
    socParallelAssembly=repmat(1, 6, 1)))

BMS_Sw_CodeGenConfig = Simulink.ConfigSet(StartTime="0", StopTime="9000", Solver="FixedStepDiscrete", ProdHWDeviceType="ARM Compatible->ARM Cortex-M", SystemTargetFile="ert.tlc", TargetLang="C")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