test file "State_Machine_Test"
  description: Test file generated automatically from model. It includes test case generated with Simulink Design Verifier, as well as logical and temporal assessments.
  coverage: Decision, MCDC, Condition

suite "State_Machine"

  suite "MainStateMachine_TestSuite"

    suite "Harness2"

      case "Standby" [equivalence]
        simulation 1:
          model State_Machine, harness State_Machine_Harness2, stop time 10
          test sequence scenario: Standby (State_Machine_Harness2/Test_Sequences)
        simulation 2:
          model State_Machine, harness State_Machine_Harness2, mode Software-in-the-Loop (SIL), stop time 10
          test sequence scenario: Standby (State_Machine_Harness2/Test_Sequences)
        equivalence criteria (1 of 5 signals compared)
          BMS_State

      case "StandbyToFault" [equivalence]
        simulation 1:
          model State_Machine, harness State_Machine_Harness2, stop time 10
          test sequence scenario: StandbyToFault (State_Machine_Harness2/Test_Sequences)
        simulation 2:
          model State_Machine, harness State_Machine_Harness2, mode Software-in-the-Loop (SIL), stop time 10
          test sequence scenario: StandbyToFault (State_Machine_Harness2/Test_Sequences)
        equivalence criteria (1 of 5 signals compared)
          BMS_State

      case "Charging" [equivalence]
        simulation 1:
          model State_Machine, harness State_Machine_Harness2, stop time 10
          test sequence scenario: Charging (State_Machine_Harness2/Test_Sequences)
        simulation 2:
          model State_Machine, harness State_Machine_Harness2, mode Software-in-the-Loop (SIL), stop time 10
          test sequence scenario: Charging (State_Machine_Harness2/Test_Sequences)
        equivalence criteria (1 of 5 signals compared)
          BMS_State

      case "ChargingToFault" [equivalence]
        simulation 1:
          model State_Machine, harness State_Machine_Harness2, stop time 10
          test sequence scenario: ChargingToFault (State_Machine_Harness2/Test_Sequences)
        simulation 2:
          model State_Machine, harness State_Machine_Harness2, mode Software-in-the-Loop (SIL), stop time 10
          test sequence scenario: ChargingToFault (State_Machine_Harness2/Test_Sequences)
        equivalence criteria (1 of 5 signals compared)
          BMS_State

      case "Driving" [equivalence]
        simulation 1:
          model State_Machine, harness State_Machine_Harness2, stop time 10
          test sequence scenario: Driving (State_Machine_Harness2/Test_Sequences)
        simulation 2:
          model State_Machine, harness State_Machine_Harness2, mode Software-in-the-Loop (SIL), stop time 10
          test sequence scenario: Driving (State_Machine_Harness2/Test_Sequences)
        equivalence criteria (1 of 5 signals compared)
          BMS_State

      case "DrivingToFault" [equivalence]
        simulation 1:
          model State_Machine, harness State_Machine_Harness2, stop time 10
          test sequence scenario: DrivingToFault (State_Machine_Harness2/Test_Sequences)
        simulation 2:
          model State_Machine, harness State_Machine_Harness2, mode Software-in-the-Loop (SIL), stop time 10
          test sequence scenario: DrivingToFault (State_Machine_Harness2/Test_Sequences)
        equivalence criteria (1 of 5 signals compared)
          BMS_State

      case "ChargingToStandby" [equivalence]
        simulation 1:
          model State_Machine, harness State_Machine_Harness2, stop time 10
          test sequence scenario: ChargingToStandby (State_Machine_Harness2/Test_Sequences)
        simulation 2:
          model State_Machine, harness State_Machine_Harness2, mode Software-in-the-Loop (SIL), stop time 10
          test sequence scenario: ChargingToStandby (State_Machine_Harness2/Test_Sequences)
        equivalence criteria (1 of 5 signals compared)
          BMS_State

      case "DrivingToStandby" [equivalence]
        simulation 1:
          model State_Machine, harness State_Machine_Harness2, stop time 10
          test sequence scenario: DrivingtoStandby (State_Machine_Harness2/Test_Sequences)
        simulation 2:
          model State_Machine, harness State_Machine_Harness2, mode Software-in-the-Loop (SIL), stop time 10
          test sequence scenario: DrivingtoStandby (State_Machine_Harness2/Test_Sequences)
        equivalence criteria (1 of 5 signals compared)
          BMS_State

    suite "Harness1" (disabled)

      case "Standby" [simulation] (disabled)
        model State_Machine, harness State_Machine_Harness1, stop time 10
        signal scenario: Standby (State_Machine_Harness1/Harness Inputs)

      case "StandbyFault" [simulation] (disabled)
        model State_Machine, harness State_Machine_Harness1, stop time 10
        signal scenario: StandbyToFault (State_Machine_Harness1/Harness Inputs)

      case "Charging" [simulation] (disabled)
        model State_Machine, harness State_Machine_Harness1, stop time 10
        signal scenario: Charging (State_Machine_Harness1/Harness Inputs)

      case "ChargingFault" [simulation] (disabled)
        model State_Machine, harness State_Machine_Harness1, stop time 10
        signal scenario: ChargingToFault (State_Machine_Harness1/Harness Inputs)

      case "Driving" [simulation] (disabled)
        model State_Machine, harness State_Machine_Harness1, stop time 10
        signal scenario: Driving (State_Machine_Harness1/Harness Inputs)

      case "DrivingFault" [simulation] (disabled)
        model State_Machine, harness State_Machine_Harness1, stop time 10
        signal scenario: DrivingToFault (State_Machine_Harness1/Harness Inputs)

  suite "FaultDetection_TestSuite"

    case "OverCurrentFault_DischargeLimit" [simulation]
      model FaultDetection, harness FaultDetection_Harness1
      signal scenario: OverCurrentFault_Discharge (FaultDetection_Harness1/Harness Inputs)
      logged signals "Signal Set 1": Harness Inputs:1.Pack_Current, Harness Inputs:2.DischargeCurrentLimit, Fault_Bus.OverCurrent, FaultPresent
      assessment "Assessment_OcFlt": At any point of time, if Pack_Current < DischargeCurrentLimit - single(0.1) becomes true and stays true for at least 1 then, starting from end of min-time, with no delay, OverCurrentFault must be true
        Pack_Current: signal FaultDetection_Harness1/Harness Inputs, port 1, element .Pack_Current
        DischargeCurrentLimit: signal FaultDetection_Harness1/Harness Inputs, port 2, element .DischargeCurrentLimit
        OverCurrentFault: signal FaultDetection_Harness1/FaultDetection, port 2, element .OverCurrent

    case "OverCurrentFault_ChargeLimit" [simulation]
      model FaultDetection, harness FaultDetection_Harness1
      signal scenario: OverCurrentFault_Charge (FaultDetection_Harness1/Harness Inputs)
      logged signals "Signal Set 1": Harness Inputs:2.ChargeCurrentLimit, Harness Inputs:1.Pack_Current, FaultPresent, Fault_Bus.OverCurrent
      assessment "Assessment_OcFlt": At any point of time, if Pack_Current > ChargeCurrentLimit + single(0.1) becomes true and stays true for at least 1 then, starting from end of min-time, with no delay, OverCurrentFault must be true
        Pack_Current: signal FaultDetection_Harness1/Harness Inputs, port 1, element .Pack_Current
        OverCurrentFault: signal FaultDetection_Harness1/FaultDetection, port 2, element .OverCurrent
        ChargeCurrentLimit: signal FaultDetection_Harness1/Harness Inputs, port 2, element .ChargeCurrentLimit

    case "OverCurrentFault_Debouncing" [simulation]
      model FaultDetection, harness FaultDetection_Harness1, stop time 10
      signal scenario: OverCurrentFault_Debounce (FaultDetection_Harness1/Harness Inputs)
      logged signals "Signal Set 1": Harness Inputs:1.Pack_Current, Harness Inputs:2.DischargeCurrentLimit, Harness Inputs:2.ChargeCurrentLimit, FaultPresent, Fault_Bus.OverCurrent
      assessment "Assessment_OcFlt_Chrg": At any point of time, if Pack_Current > ChargeCurrentLimit + single(0.1) becomes true and stays true for between 0.1 and 0.9 then, starting from rising edge of trigger, with no delay, OverCurrentFault == false must be true
      assessment "Assessment_OcFlt_Dchrg": At any point of time, if Pack_Current < DischargeCurrentLimit - single(0.1) becomes true and stays true for between 0.1 and 0.9 then, starting from rising edge of trigger, with no delay, OverCurrentFault == false must be true
        Pack_Current: signal FaultDetection_Harness1/Harness Inputs, port 1, element .Pack_Current
        ChargeCurrentLimit: signal FaultDetection_Harness1/Harness Inputs, port 2, element .ChargeCurrentLimit
        OverCurrentFault: signal FaultDetection_Harness1/FaultDetection, port 2, element .OverCurrent
        DischargeCurrentLimit: signal FaultDetection_Harness1/Harness Inputs, port 2, element .DischargeCurrentLimit

    case "HighTempFault" [simulation]
      model FaultDetection, harness FaultDetection_Harness1, stop time 10
      signal scenario: HighTempFault (FaultDetection_Harness1/Harness Inputs)
      logged signals "Signal Set 1": FaultPresent, Fault_Bus.HighTemp, Harness Inputs:3.MaxCellTemp
      assessment "Assessment_HtFlt": At any point of time, if MaxCellTemp > HighTempLimit becomes true then, with no delay, HighTempFault == true must be true
        MaxCellTemp: signal FaultDetection_Harness1/Harness Inputs, port 3, element .MaxCellTemp
        HighTempLimit: variable FaultDetection_Harness1/FaultDetection|FaultDetection/FaultDetection
        HighTempFault: signal FaultDetection_Harness1/Output Conversion Subsystem, port 2, element .HighTemp

    case "LowTempFault" [simulation]
      model FaultDetection, harness FaultDetection_Harness1, stop time 10
      signal scenario: LowTempFault (FaultDetection_Harness1/Harness Inputs)
      logged signals "Signal Set 1": Harness Inputs:3.MinCellTemp, FaultPresent, Fault_Bus.LowTemp
      assessment "Asseessment_LtFlt": At any point of time, if MinCellTemp < LowTempLimit becomes true then, with no delay, LowTempFault == true must be true
        MinCellTemp: signal FaultDetection_Harness1/Harness Inputs, port 3, element .MinCellTemp
        LowTempLimit: variable FaultDetection_Harness1/FaultDetection|FaultDetection/FaultDetection
        LowTempFault: signal FaultDetection_Harness1/Output Conversion Subsystem, port 2, element .LowTemp

    case "OverVoltageFault" [simulation]
      model FaultDetection, harness FaultDetection_Harness1, stop time 10
      signal scenario: OverVoltageFault (FaultDetection_Harness1/Harness Inputs)
      logged signals "Signal Set 1": Harness Inputs:3.MaxCellVolt, Fault_Bus.OverVolt, FaultPresent
      assessment "Assessment_OvFlt": At any point of time, if MaxCellVolt > OverCellVoltageLimit becomes true then, with no delay, OverVoltageFault == true must be true
        MaxCellVolt: signal FaultDetection_Harness1/Harness Inputs, port 3, element .MaxCellVolt
        OverCellVoltageLimit: variable FaultDetection_Harness1/FaultDetection|FaultDetection/FaultDetection
        OverVoltageFault: signal FaultDetection_Harness1/FaultDetection, port 2, element .OverVolt

    case "UnderVoltageFault" [simulation]
      model FaultDetection, harness FaultDetection_Harness1, stop time 10
      signal scenario: UnderVoltageFault (FaultDetection_Harness1/Harness Inputs)
      logged signals "Signal Set 1": Harness Inputs:3.MinCellVolt, FaultPresent, Fault_Bus.UnderVolt
      assessment "Assessment_UvFlt": At any point of time, if MinCellVolt < UnderCellVoltageLimit becomes true then, with no delay, UnderVoltageFault == true must be true
        UnderCellVoltageLimit: variable FaultDetection_Harness1/FaultDetection|FaultDetection/FaultDetection
        MinCellVolt: signal FaultDetection_Harness1/Harness Inputs, port 3, element .MinCellVolt
        UnderVoltageFault: signal FaultDetection_Harness1/FaultDetection, port 2, element .UnderVolt

    case "VoltSensorFault" [simulation] (disabled)
      model FaultDetection, harness FaultDetection_Harness1, stop time 10
      signal scenario: VoltageSensorFault (FaultDetection_Harness1/Harness Inputs)
      logged signals "Signal Set 1": Harness Inputs:1.Cell_Voltages, Harness Inputs:1.Pack_Voltage, FaultPresent, Fault_Bus.VoltSensor
      assessment "Assessment_VoltSnsFlt": At any point of time, if (Pack_Voltage - (Cell_Voltage1 + Cell_Voltage2 + Cell_Voltage3 + Cell_Voltage4 + Cell_Voltage5 + Cell_Voltage6)) > SnsrFltThld becomes true then, with no delay, VoltSensorFault must be true
        Cell_Voltage1: signal FaultDetection_Harness1/Harness Inputs, port 1, element .Cell_Voltages(1)
        Cell_Voltage2: signal FaultDetection_Harness1/Harness Inputs, port 1, element .Cell_Voltages(2)
        Cell_Voltage3: signal FaultDetection_Harness1/Harness Inputs, port 1, element .Cell_Voltages(3)
        Cell_Voltage4: signal FaultDetection_Harness1/Harness Inputs, port 1, element .Cell_Voltages(4)
        Cell_Voltage5: signal FaultDetection_Harness1/Harness Inputs, port 1, element .Cell_Voltages(5)
        Cell_Voltage6: signal FaultDetection_Harness1/Harness Inputs, port 1, element .Cell_Voltages(6)
        Pack_Voltage: signal FaultDetection_Harness1/Harness Inputs, port 1, element .Pack_Voltage
        VoltSensorFault: signal FaultDetection_Harness1/Output Conversion Subsystem, port 2, element .VoltSensor
        SnsrFltThld: variable FaultDetection_Harness1/FaultDetection|FaultDetection/FaultDetection

    case "ChrgCntctFault" [simulation]
      model FaultDetection, harness FaultDetection_Harness1, stop time 10
      signal scenario: ChrgCntctFault (FaultDetection_Harness1/Harness Inputs)
      logged signals "Signal Set 1": Harness Inputs:4, Fault_Bus.Charger, FaultPresent
      assessment "Assessment1": At any point of time, if ChrgCntctState == Fault becomes true then, with no delay, ChargerFault must be true
        ChrgCntctState: signal FaultDetection_Harness1/Harness Inputs, port 4
        Fault: expression Contact(3)
        ChargerFault: signal FaultDetection_Harness1/FaultDetection, port 2, element .Charger

    case "InvtrCntctFault" [simulation]
      model FaultDetection, harness FaultDetection_Harness1, stop time 10
      signal scenario: InvtrCntctFault (FaultDetection_Harness1/Harness Inputs)
      logged signals "Signal Set 1": FaultPresent, Harness Inputs:5, Fault_Bus.Inverter
      assessment "Assessment1": At any point of time, if InvtrCntctState == Fault becomes true then, with no delay, InverterFault must be true
        InvtrCntctState: signal FaultDetection_Harness1/Harness Inputs, port 5
        Fault: expression Contact(3)
        InverterFault: signal FaultDetection_Harness1/FaultDetection, port 2, element .Inverter

  suite "ContactorManagement_TestSuite"

    case "Standby" [simulation]
      model ContactorMgmt, harness ContactorMgmt_Harness1, stop time 10
      signal scenario: Standby (ContactorMgmt_Harness1/Harness Inputs)

    case "Charging" [simulation]
      model ContactorMgmt, harness ContactorMgmt_Harness1, stop time 10
      signal scenario: Charging (ContactorMgmt_Harness1/Harness Inputs)

    case "ChargingToDriving" [simulation]
      model ContactorMgmt, harness ContactorMgmt_Harness1, stop time 10
      signal scenario: ChargingToDriving (ContactorMgmt_Harness1/Harness Inputs)

    case "ChargingToStandby" [simulation]
      model ContactorMgmt, harness ContactorMgmt_Harness1, stop time 10
      signal scenario: ChargingToStandby (ContactorMgmt_Harness1/Harness Inputs)

    case "Driving" [simulation]
      model ContactorMgmt, harness ContactorMgmt_Harness1, stop time 10
      signal scenario: Driving (ContactorMgmt_Harness1/Harness Inputs)

    case "DrivingToCharging" [simulation]
      model ContactorMgmt, harness ContactorMgmt_Harness1, stop time 10
      signal scenario: DrivingToCharging (ContactorMgmt_Harness1/Harness Inputs)

    case "DrivingToStandby" [simulation]
      model ContactorMgmt, harness ContactorMgmt_Harness1, stop time 10
      signal scenario: DrivingToStandby (ContactorMgmt_Harness1/Harness Inputs)