test file "BMS_ClosedLoop_Test"
  description: Assess requirements on charge/discharge current limits with Obsever blocks.
  coverage: Decision, MCDC, Condition

suite "DrivingChargeCycleTestSuite"

  case "Test_Scenarios" [simulation]
    model BMS_Software, harness BMS_Software_Harness1, mode Normal
    parameter set "Parameter Set 1" (off):
      Active_Scenario_Index = 1  % Shared_DD.sldd
      BattSocInit = 0.75  % Battery_1Pack_1RC.sldd
      BattTempInit = 25  % Battery_1Pack_1RC.sldd
      SOCInit = 0.75  % DD_SOC_Estimation.sldd
      TempInit = 25  % DD_Battery.sldd
    parameter set "Parameter Set 2" (off):
      Active_Scenario_Index = 2  % Shared_DD.sldd
      BattSocInit = 0.25  % Battery_1Pack_1RC.sldd
      BattTempInit = 25  % Battery_1Pack_1RC.sldd
      SOCInit = 0.25  % DD_SOC_Estimation.sldd
      TempInit = 25  % DD_Battery.sldd
    parameter set "Parameter Set 3" (off):
      Active_Scenario_Index = 3  % Shared_DD.sldd
      BattSocInit = 0.85  % Battery_1Pack_1RC.sldd
      BattTempInit = 25  % Battery_1Pack_1RC.sldd
      SOCInit = 0.85  % DD_SOC_Estimation.sldd
      TempInit = 25  % DD_Battery.sldd
    logged signals "Signal Set 1": BMS_Info.SOC.SOC_CC, BMS_Info.SOC.SOC_UKF, BMS_Info.SOC.SOC_EKF, KnownSOC, Sensors.Cell_Voltages, Sensors.Pack_Current, Sensors.Cell_Temperatures, BMS_Cmd.CurrentLimits_Bus.DischargeCurrentLimit, BMS_Cmd.CurrentLimits_Bus.ChargeCurrentLimit
    iterations:
      Driving_Charging_Rest: ParameterSet "Parameter Set 1"  % Initial Battery SOC at 75%, Battery Temperature at 25 degreeC, Drive for 1 Hours, Then Charge Until SOC >= 98%
      Charging: ParameterSet "Parameter Set 2"  % Initial Battery SOC at 25%, Battery Temperature at 25 degreeC, Charge Until SOC >= 98%
      Driving: ParameterSet "Parameter Set 3"  % Initial Battery SOC at 85%, Battery Temperature at 25 degreeC, Drive for 2 Hours